# Grasshopper definition spellshape-grasshopper.gh (Grasshopper 1.0.7)

# ----
# SPELLSHAPE GRASSHOPPER QUICK START
# 
# There are two main GHPython nodes:
# 
# 1. Decomposed Builder
#    Calls your chosen LLM provider and outputs current_obj.
# 
# 2. Live OBJ Renderer
#    Reads current_obj, creates Rhino meshes, and creates automatic controls.
# 
# Basic wiring:
# Builder current_obj -> Renderer live_obj
# Renderer meshes -> Mesh preview / Custom Preview / Bake workflow
# Generated sliders/toggles -> Renderer values
# 
# How to run:
# 1. In the Decomposed Builder node, choose provider: openai, openrouter, anthropic, google, gemini, or custom.
# 2. Paste your own API key into the api_key Panel.
# 3. Type a scene prompt into the prompt Panel.
# 4. Press the Builder plan_run button once.
# 5. Press the Builder next_run button repeatedly, or enable auto_run.
# 6. Watch Builder progress / active_part / status.
# 7. In the Renderer node, press refresh_controls after new #@controls appear.
# 8. Adjust generated sliders/toggles. They feed the Renderer values input.
# 9. Press Builder reset before starting a totally unrelated object.
# 
# Never share a GH file with your API key still inside it.
button = Button()
builder_script = GhPythonScript(plan_run=button, auto_run=Toggle(True), reset=Button(), provider="gemini", model="gemini-3.5-flash")  # -> out, current_obj, plan_json, parts, active_part, progress, status, error, debug; inputs plan_run: Boolean, next_run: Boolean, auto_run: Boolean, auto_delay_ms: Int32, reset: Boolean
# ---------- builder_script: Python ----------
# Spellshape Grasshopper - Decomposed Raw OBJ Builder
# Release date: 2026-05-17
# License: MIT
# Source: https://github.com/StepanKukharskiy/live-obj
#
# Network behavior:
# - Calls the selected LLM provider directly from this machine.
# - Does not call Spellshape servers.
# - Does not send telemetry from this script.
# - Never paste/share a GH file with a filled API key panel.
#
# Prompt source of truth:
# - Planner and part-generation prompts are synced from the web app TypeScript
#   prompt constants by scripts/sync_ghpython_prompts.py.
#
# Inputs to create:
#   plan_run       bool  button: create a part plan from prompt
#   next_run       bool  button: generate and append the next planned part
#   auto_run       bool  toggle: keep generating one remaining part per solution
#   auto_delay_ms  int   optional delay between automatic parts, default 250
#   reset          bool  button: clear plan and scene memory
#   provider       str   openai, openrouter, anthropic, google, gemini, custom
#   api_key        str
#   model          str   optional
#   prompt         str   scene request
#   base_url       str   optional for OpenAI-compatible custom providers
#   max_tokens     int   optional, default 16000
#   timeout_sec    int   optional HTTP timeout, default 300
#
# Outputs to create:
#   current_obj
#   plan_json
#   parts
#   active_part
#   progress
#   status
#   error
#   debug
#
# Workflow:
#   1. Set prompt, press plan_run.
#   2. Press next_run repeatedly, or set auto_run=True.
#   3. Wire current_obj into the Live OBJ render GHPython node.
#   4. Press reset to start a new decomposed scene.

import json
import re
import System
import scriptcontext as sc
from System.IO import StreamReader
from System.Net import WebRequest, ServicePointManager, SecurityProtocolType
from System.Text import Encoding


DEFAULT_HEADER = "#@live_obj_version: 0.1\n#@up: y\n"


PLANNER_PROMPT = '''You are the planner for an AI-native Live OBJ modeling pipeline.

Decompose the requested scene into a build queue of semantic parts. Do not generate geometry.
The next system stage will ask for each part as a separate Live OBJ object/group and append it to the scene.

Return only JSON with this shape:
{
  "scene": "short scene description",
  "units": "meters",
  "up": "y",
  "materials": [
    { "id": "material_id", "color": "#RRGGBB", "roughness": 0.7, "metalness": 0, "role": "short role" }
  ],
  "parts": [
    {
      "id": "stable_object_or_group_id",
      "role": "what this part contributes",
      "method": "llm_mesh",
      "dependencies": ["prior_part_id"],
      "prompt": "specific instructions for generating only this part",
      "validationHints": ["bbox/contact/detail expectations"]
    }
  ],
  "notes": ["global composition notes"]
}

Planning rules:
- Prefer 5-8 parts for rich scenes; fewer for simple objects.
- First pass should be compact semantic massing: major ground/support, primary structure, main envelope/shell, major infill/openings, and one restrained interior/context part only when important.
- Build from coarse support/massing to envelope, structure, major infill, then one optional accent/detail part.
- Merge related elements into one part instead of producing many small parts.
- Do not plan separate first-pass parts for seams, fasteners, bolts, handles, bollards, expansion joints, connection plates, tiny context objects, or micro facade details unless the user explicitly asks for them.
- Make dependencies explicit so later parts can align to earlier geometry.
- Use y as the vertical/up axis unless the user explicitly asks otherwise.
- Plan raw mesh parts. Each part method must be "llm_mesh".
- Do not use method values "procedural", "recipe", or "hybrid" in this iterative raw OBJ planner.
- Do not invent executor operations. The default generation method is llm_mesh with semantic metadata and optional generic post notes.
- If the user asks for controls, sliders, parameters, adjustable dimensions, or editability, preserve that requirement in the relevant part prompts. Do not treat metadata controls as forbidden UI objects.
- In this Grasshopper decomposed builder, every planned part should expose 2-5 practical Grasshopper controls by default. Add that requirement to each part prompt using #@params and #@controls metadata, with every control referenced by executable #@post syntax.
- Use stable snake_case ids.'''


PART_SYSTEM_PROMPT = '''You generate one raw OBJ part for an iterative scene builder.

Return only OBJ text for the requested part. Do not return JSON, Markdown, a scene header, or explanations.

Critical OBJ indexing rule:
- Use local vertex numbering in your returned part. The first vertex you emit is v 1 for face purposes.
- Face lines must reference only vertices defined in this returned part, starting at 1.
- The server will remap indices when appending to the full scene.

Raw-first part rules:
- Use #@source: llm_mesh for the generated object/group.
- Include #@editable, #@semantic, #@part, #@part_of, and #@depends_on metadata where useful.
- Use #@bbox: min=[x,y,z] max=[x,y,z] when the intended extents are clear.
- Use #@lock: footprint, position, silhouette, material when future edits should preserve those properties.
- Use #@anchor: id=anchor_id at=[x,y,z] for meaningful connection, contact, edge, support, hinge, or alignment points.
- Use #@constraint: as soft edit intent only, such as roof must_touch walls or object must_rest_on_ground.
- Use #@variant: id=base name="Base" when a generated part is one named concept alternative.
- Generate only the requested part, not the whole scene.
- Fit the part to the existing scene summary and dependencies.
- Use y as the vertical/up axis unless the current scene summary says otherwise.
- Keep geometry compact and clean: target 20-90 vertices for ordinary parts and at most about 160 vertices for a main shell. Use simple topology for the first pass; use #@post smooth/subdivide when a softer surface is intended.
- Match topology to visible intent: if the requested visual property cannot be produced by supported executable #@post syntax, bake it into the raw v/f mesh with enough vertices/faces for the effect to be visible. Do not satisfy visible geometry requests only with object names, #@semantic, #@tag, material names, or unsupported #@post attributes.
- Prefer quads and simple polygons. Avoid dense grids, seam networks, individual fasteners, tiny bolts, repeated micro-panels, or context clutter in the first pass.
- Every raw mesh object or group with vertices must include faces for those vertices. Do not emit vertices-only logs, rings, lattices, supports, or roof members.
- If you create multiple log cylinders or beams in one object, include the side faces and cap faces for every member. Do not list only section rings or endpoints.
- Avoid usemtl-only groups. A group is useful only when it contains renderable faces.
- Use #@post: for raw-post modifier intent. Supported #@post ops are transform, symmetrize, mirror, array, deform, subdivide, smooth, simplify, snap_to_ground, center_origin, material, and tag.
- For repeated modules, #@post array supports per-copy expressions in scale, position, and pivot using i, index, step, count, t, sin(), cos(), min(), max(), abs(), sqrt(), pi, and tau.
- For per-vertex edits, #@post deform supports position=[x,y,z] expressions with x/y/z, normalized u/v/w bbox coordinates, i/index, t, vertex_count, params, and the same math functions.
- Prefer #@post symmetrize for bilaterally symmetric forms and #@post smooth/subdivide for fluid surfaces.
- If the user request, plan, or part prompt asks for controls, include #@params: and #@controls: metadata for meaningful dimensions. Every control key must be referenced by executable #@post metadata such as transform, array, mirror/symmetrize, smooth, subdivide, simplify, snap_to_ground, or center_origin. For raw v/f meshes, use controls for object-level scale, height, spacing, count, smoothing, or placement rather than pretending baked vertex coordinates are parametric.
- Parameter references in #@post expressions must use bare names such as voxel_size or (voxel_size*grid_width)/10. Never use template placeholder syntax such as dollar-brace or curly-brace parameter wrappers.
- Put material and tag assignments inside #@post blocks. Do not use #@ops in raw-first mode.
- Always use block syntax: #@post: then lines like #@ - material name=mat_id. Do not emit inline #@post material id=... lines.'''


SUPPORTED_POST_OPS = set([
    "transform",
    "symmetrize",
    "mirror",
    "array",
    "deform",
    "subdivide",
    "smooth",
    "simplify",
    "snap_to_ground",
    "center_origin",
    "material",
    "tag",
])

SUPPORTED_POST_ATTRS = {
    "transform": set(["position", "rotation", "scale", "pivot"]),
    "symmetrize": set(["axis", "side", "tolerance"]),
    "mirror": set(["axis"]),
    "array": set(["count", "offset", "centered", "center", "scale", "position", "pivot"]),
    "deform": set(["position", "expr", "xyz"]),
    "subdivide": set(["level"]),
    "smooth": set(["iterations", "strength"]),
    "simplify": set(["ratio"]),
    "snap_to_ground": set(["axis"]),
    "center_origin": set(["axes"]),
    "material": set(["name"]),
    "tag": set(["value"]),
}


POST_REPAIR_PROMPT = '''You repair one raw OBJ part for the Spellshape Live OBJ executor.

Return only complete OBJ text for the same part. Do not return Markdown or explanations.
Preserve the object's geometry, object names, metadata, faces, and material intent.
Fix only invalid #@post syntax reported by the executor validation.

Supported #@post operations:
- transform position=[x,y,z] rotation=[rx,ry,rz] scale=[sx,sy,sz] pivot=[x,y,z]
- symmetrize axis=x|y|z side=positive|negative tolerance=0.000001
- mirror axis=x|y|z
- array count=n offset=[x,y,z] centered=true|false scale=[sx,sy,sz] position=[x,y,z] pivot=[x,y,z]
- deform position=[x,y,z]
- subdivide level=n
- smooth iterations=n strength=0.5
- simplify ratio=0.5
- snap_to_ground axis=x|y|z
- center_origin axes=xz|xy|yz|xyz
- material name=material_id
- tag value=tag_text

Important:
- smooth uses iterations=, not level=.
- subdivide uses level=.
- material uses name= only. Do not include target=, object=, id=, color=, roughness=, or metalness=.
- transform uses position=, rotation=, scale=, and optional pivot=. Do not use target=, origin=, translate=, rotate=, rotate_y=, axis=, spacing=, or mode=.
- Unsupported visible behavior must be baked into v/f geometry rather than described with unsupported #@post attributes.
- Always use block syntax: #@post: then #@ - operation args...'''


CONTROL_REPAIR_PROMPT = '''You repair one raw OBJ part for the Spellshape Grasshopper renderer.

Return only complete OBJ text for the same part. Do not return Markdown or explanations.
Preserve the object's geometry, object names, faces, material intent, and role.
This Grasshopper decomposed-builder part requires controls, but it did not include #@controls metadata.

Add minimal useful controls using:
#@params: key=value, key=value
#@controls:
#@ - slider key=key label=Readable_label min=a max=b step=c

Rules:
- Every control key must be referenced by executable #@post metadata.
- For raw v/f meshes, useful controls are object scale, height, width/depth, vertical exaggeration, smoothing, array count/spacing, or placement.
- Parameter references in #@post expressions must use bare names such as tree_scale or (voxel_size*grid_width)/10.
- Never use template syntax like ${tree_scale}, {tree_scale}, or ${voxel_size}.
- Do not create controls that only sit in #@params without affecting geometry.
- Keep controls small and practical.'''


def safe_str(value, fallback=""):
    if value is None:
        return fallback
    return str(value)


def input_value(name, fallback=None):
    try:
        return globals().get(name, fallback)
    except Exception:
        return fallback


def bool_input(name, fallback=False):
    return bool(input_value(name, fallback))


def key(name):
    try:
        guid = str(ghenv.Component.InstanceGuid)
    except Exception:
        guid = "default"
    return "spellshape_decomposed:%s:%s" % (guid, name)


def get_mem(name, fallback=""):
    return sc.sticky.get(key(name), fallback)


def set_mem(name, value):
    sc.sticky[key(name)] = value


def button_pressed(name):
    now = bool_input(name, False)
    last_key = key("last_input:" + name)
    was = bool(sc.sticky.get(last_key, False))
    sc.sticky[last_key] = now
    return now and not was


def clear_mem():
    for name in ("current_obj", "plan_json", "part_index", "last_raw", "last_part", "scene_prompt"):
        set_mem(name, "" if name != "part_index" else 0)


def set_message(text):
    try:
        ghenv.Component.Message = text
    except Exception:
        pass


def schedule_next(delay_ms):
    try:
        doc = ghenv.Component.OnPingDocument()
        if doc is not None:
            doc.ScheduleSolution(int(delay_ms), lambda d: ghenv.Component.ExpireSolution(False))
    except Exception:
        pass


def parse_max_tokens(value):
    try:
        n = int(value)
    except Exception:
        n = 16000
    return max(512, min(16000, n))


def parse_timeout_ms(value):
    try:
        seconds = int(value)
    except Exception:
        seconds = 300
    seconds = max(30, min(900, seconds))
    return seconds * 1000


def normalize_base_url(url):
    url = safe_str(url).strip()
    if not url:
        return ""
    if url.lower().endswith("/chat/completions"):
        url = url[:-len("/chat/completions")]
    return url.rstrip("/")


def post_json(url, headers, payload):
    try:
        ServicePointManager.SecurityProtocol = SecurityProtocolType.Tls12
    except Exception:
        pass

    body = json.dumps(payload)
    data = Encoding.UTF8.GetBytes(body)
    req = WebRequest.Create(url)
    req.Method = "POST"
    req.ContentType = "application/json"
    req.ContentLength = data.Length
    timeout_ms = parse_timeout_ms(input_value("timeout_sec", None))
    try:
        req.Timeout = timeout_ms
        req.ReadWriteTimeout = timeout_ms
    except Exception:
        pass
    for k, v in headers.items():
        req.Headers[k] = v
    stream = req.GetRequestStream()
    try:
        stream.Write(data, 0, data.Length)
    finally:
        stream.Close()

    try:
        resp = req.GetResponse()
        reader = StreamReader(resp.GetResponseStream())
        try:
            return reader.ReadToEnd()
        finally:
            reader.Close()
            resp.Close()
    except System.Net.WebException as ex:
        resp = ex.Response
        if resp is None:
            raise
        reader = StreamReader(resp.GetResponseStream())
        try:
            detail = reader.ReadToEnd()
        finally:
            reader.Close()
            resp.Close()
        raise Exception("HTTP request failed: " + detail)


def use_max_completion_tokens(provider_name, base_url, model_name):
    provider_name = safe_str(provider_name).lower()
    base_url = safe_str(base_url).lower()
    model_name = safe_str(model_name).lower()
    return provider_name == "openai" or "api.openai.com" in base_url or model_name.startswith("gpt-5") or model_name.startswith("o1") or model_name.startswith("o3") or model_name.startswith("o4")


def call_openai_compatible(provider_name, api_key, model_name, system_prompt, user_prompt, base_url, max_tokens):
    base = normalize_base_url(base_url)
    if not base:
        base = "https://openrouter.ai/api/v1" if provider_name == "openrouter" else "https://api.openai.com/v1"
    endpoint = base + "/chat/completions"
    if not model_name:
        model_name = "openai/gpt-4.1-mini" if provider_name == "openrouter" else "gpt-4.1-mini"
    payload = {
        "model": model_name,
        "messages": [
            {"role": "system", "content": system_prompt},
            {"role": "user", "content": user_prompt},
        ],
    }
    if use_max_completion_tokens(provider_name, base, model_name):
        payload["max_completion_tokens"] = max_tokens
    else:
        payload["max_tokens"] = max_tokens
    headers = {"Authorization": "Bearer " + api_key}
    if provider_name == "openrouter":
        headers["HTTP-Referer"] = "https://spellshape.local"
        headers["X-Title"] = "Spellshape Grasshopper"
    return post_json(endpoint, headers, payload)


def call_anthropic(api_key, model_name, system_prompt, user_prompt, max_tokens):
    if not model_name:
        model_name = "claude-3-5-sonnet-latest"
    payload = {
        "model": model_name,
        "max_tokens": max_tokens,
        "system": system_prompt,
        "messages": [{"role": "user", "content": user_prompt}],
    }
    return post_json("https://api.anthropic.com/v1/messages", {
        "x-api-key": api_key,
        "anthropic-version": "2023-06-01",
    }, payload)


def call_google(api_key, model_name, system_prompt, user_prompt, max_tokens):
    if not model_name:
        model_name = "gemini-2.5-flash"
    payload = {
        "contents": [{"role": "user", "parts": [{"text": user_prompt}]}],
        "generationConfig": {"maxOutputTokens": max_tokens},
        "systemInstruction": {"parts": [{"text": system_prompt}]},
    }
    url = "https://generativelanguage.googleapis.com/v1beta/models/%s:generateContent" % model_name
    return post_json(url, {"x-goog-api-key": api_key}, payload)


def call_provider(provider_name, api_key, model_name, system_prompt, user_prompt, base_url, max_tokens):
    provider_name = safe_str(provider_name, "openai").strip().lower()
    if provider_name == "anthropic":
        return call_anthropic(api_key, model_name, system_prompt, user_prompt, max_tokens)
    if provider_name in ("google", "gemini"):
        return call_google(api_key, model_name, system_prompt, user_prompt, max_tokens)
    return call_openai_compatible(provider_name, api_key, model_name, system_prompt, user_prompt, base_url, max_tokens)


def extract_text(provider_name, raw):
    try:
        root = json.loads(raw)
    except Exception:
        return raw
    provider_name = safe_str(provider_name).lower()
    if provider_name == "anthropic":
        return "".join([p.get("text", "") for p in root.get("content", []) if isinstance(p, dict)])
    if provider_name in ("google", "gemini"):
        candidates = root.get("candidates", [])
        if not candidates:
            return raw
        parts = candidates[0].get("content", {}).get("parts", [])
        return "".join([p.get("text", "") for p in parts if isinstance(p, dict)])
    choices = root.get("choices", [])
    if not choices:
        return raw
    content = choices[0].get("message", {}).get("content", "")
    return content or raw


def strip_code_fence(text):
    text = safe_str(text).strip()
    if not text.startswith("```"):
        return text
    first = text.find("\n")
    last = text.rfind("```")
    if first >= 0 and last > first:
        return text[first + 1:last].strip()
    return text


def parse_json_object(text):
    clean = strip_code_fence(text)
    try:
        return json.loads(clean)
    except Exception:
        start = clean.find("{")
        end = clean.rfind("}")
        if start >= 0 and end > start:
            return json.loads(clean[start:end + 1])
        raise


def count_vertices(text):
    return len([l for l in safe_str(text).splitlines() if re.match(r"^\s*v\s+", l)])


def count_faces(text):
    return len([l for l in safe_str(text).splitlines() if re.match(r"^\s*f\s+", l)])


def split_part_text(raw_part):
    clean = normalize_generated_part_metadata(raw_part)
    lines = clean.splitlines()
    first_obj = -1
    for i, line in enumerate(lines):
        if re.match(r"^\s*o\s+", line):
            first_obj = i
            break
    if first_obj < 0:
        raise Exception("Generated part did not contain an object line: o name")
    preamble = []
    object_metadata = []
    for line in lines[:first_obj]:
        if re.match(r"^\s*#@material_preset:\s+", line):
            preamble.append(line)
        elif re.match(r"^\s*#@", line):
            object_metadata.append(line)
    obj_lines = list(lines[first_obj:])
    if object_metadata:
        obj_lines = [obj_lines[0]] + object_metadata + obj_lines[1:]
    obj_text = "\n".join(obj_lines).strip()
    return preamble, obj_text


def face_refs(line):
    if not re.match(r"^\s*[fl]\s+", line):
        return []
    out = []
    for token in line.strip().split()[1:]:
        head = token.split("/")[0]
        try:
            out.append(int(head))
        except Exception:
            pass
    return out


def remap_token(token, vertex_offset, local_offset):
    parts = token.split("/")
    try:
        n = int(parts[0])
    except Exception:
        return token
    if n <= 0:
        return token
    parts[0] = str(n - local_offset + vertex_offset)
    return "/".join(parts)


def remap_part_faces(obj_text, vertex_offset):
    local_count = count_vertices(obj_text)
    refs = []
    for line in obj_text.splitlines():
        refs.extend(face_refs(line))
    max_ref = max(refs) if refs else 0
    min_ref = min(refs) if refs else 1
    local_offset = 0
    if max_ref > local_count and min_ref > 1:
        proposed = min_ref - 1
        if all((r - proposed) >= 1 and (r - proposed) <= local_count for r in refs):
            local_offset = proposed
    if max_ref - local_offset > local_count:
        raise Exception("Generated part uses face index %s but only defines %s vertices" % (max_ref, local_count))
    out = []
    for line in obj_text.splitlines():
        if not re.match(r"^\s*[fl]\s+", line):
            out.append(line)
            continue
        tokens = line.strip().split()
        out.append(" ".join([tokens[0]] + [remap_token(t, vertex_offset, local_offset) for t in tokens[1:]]))
    return "\n".join(out)


def material_ids(text):
    return set(re.findall(r"^\s*#@material_preset:\s+([^\s]+)", safe_str(text), re.M))


def first_post_attribute_value(body, keys):
    for attr in keys:
        m = re.search(r"(?:^|\s)%s\s*=\s*(\"[^\"]+\"|'[^']+'|[^\s]+)" % re.escape(attr), safe_str(body), re.I)
        if not m:
            continue
        return m.group(1).strip().strip("\"'")
    return ""


def normalize_material_post_line(raw_line):
    block = re.match(r"^(\s*)#@\s*-\s*material\b(.*)$", safe_str(raw_line), re.I)
    if block:
        material_name = first_post_attribute_value(block.group(2), ["name", "id"])
        if material_name:
            return [block.group(1) + "#@ - material name=" + material_name]
        return None
    inline = re.match(r"^(\s*)#@post\s+material\b(.*)$", safe_str(raw_line), re.I)
    if inline:
        material_name = first_post_attribute_value(inline.group(2), ["name", "id"])
        if material_name:
            indent = inline.group(1)
            return [indent + "#@post:", indent + "#@ - material name=" + material_name]
        return None
    return None


def normalize_generated_part_metadata(raw_part):
    lines = []
    for line in strip_code_fence(raw_part).splitlines():
        normalized = normalize_material_post_line(line)
        if normalized is None:
            lines.append(line)
        else:
            lines.extend(normalized)
    return "\n".join(lines)


def insert_materials(scene_text, preamble):
    existing = material_ids(scene_text)
    additions = []
    for line in preamble:
        m = re.match(r"^\s*#@material_preset:\s+([^\s]+)", line)
        if m and m.group(1) not in existing:
            additions.append(line)
    if not additions:
        return scene_text
    lines = scene_text.splitlines()
    first_obj = -1
    for i, line in enumerate(lines):
        if re.match(r"^\s*o\s+", line):
            first_obj = i
            break
    if first_obj < 0:
        return scene_text.rstrip() + "\n" + "\n".join(additions) + "\n"
    return "\n".join(lines[:first_obj] + additions + lines[first_obj:]) + "\n"


def append_part(scene_text, raw_part):
    base = safe_str(scene_text).strip()
    if not base:
        base = DEFAULT_HEADER.strip()
    preamble, obj_text = split_part_text(raw_part)
    remapped = remap_part_faces(obj_text, count_vertices(base))
    with_materials = insert_materials(base + "\n", preamble)
    return with_materials.rstrip() + "\n\n" + remapped.strip() + "\n", remapped


def split_scene_blocks(scene_text):
    lines = safe_str(scene_text).splitlines()
    first_obj = -1
    for i, line in enumerate(lines):
        if re.match(r"^\s*o\s+", line):
            first_obj = i
            break
    if first_obj < 0:
        return "\n".join(lines).rstrip(), []
    header = "\n".join(lines[:first_obj]).rstrip()
    blocks = []
    start = first_obj
    for i in range(first_obj + 1, len(lines)):
        if re.match(r"^\s*o\s+", lines[i]):
            block = "\n".join(lines[start:i]).strip()
            name = lines[start].strip().split(None, 1)[1].strip()
            blocks.append((name, block))
            start = i
    block = "\n".join(lines[start:]).strip()
    if block:
        name = lines[start].strip().split(None, 1)[1].strip()
        blocks.append((name, block))
    return header, blocks


def object_names(scene_text):
    return [name for name, _ in split_scene_blocks(scene_text)[1]]


def has_scene_objects(scene_text):
    return len(object_names(scene_text)) > 0


def normalize_scene_indices(scene_text):
    header, blocks = split_scene_blocks(scene_text)
    if not blocks:
        return safe_str(scene_text).strip() + "\n"
    out = [header] if header else []
    vertex_offset = 0
    normalized_blocks = []
    for name, block in blocks:
        remapped = remap_part_faces(block, vertex_offset)
        normalized_blocks.append(remapped.strip())
        vertex_offset += count_vertices(remapped)
    return "\n\n".join(out + normalized_blocks).strip() + "\n"


def replace_part(scene_text, raw_part, target_name):
    base = safe_str(scene_text).strip() or DEFAULT_HEADER.strip()
    preamble, obj_text = split_part_text(raw_part)
    with_materials = insert_materials(base + "\n", preamble)
    header, blocks = split_scene_blocks(with_materials)
    if not target_name:
        target_name = split_scene_blocks(obj_text)[1][0][0]
    replaced = False
    out_blocks = []
    for name, block in blocks:
        if name == target_name:
            out_blocks.append(obj_text.strip())
            replaced = True
        else:
            out_blocks.append(block.strip())
    if not replaced:
        out_blocks.append(obj_text.strip())
    return normalize_scene_indices("\n\n".join(([header] if header else []) + out_blocks)), obj_text.strip()


def part_target(part):
    for key_name in ("target", "target_object", "object", "object_id", "id"):
        value = part.get(key_name)
        if value:
            return safe_str(value).strip()
    return ""


def part_action(part, current_scene):
    action = safe_str(part.get("action") or part.get("operation") or part.get("mode"), "").strip().lower()
    target = part_target(part)
    if action in ("replace", "modify", "update", "regenerate", "edit"):
        return "replace", target
    if action in ("append", "add", "create", "new"):
        return "append", target
    if target and target in object_names(current_scene):
        return "replace", target
    return "append", target


def summarize_scene(scene_text):
    names = re.findall(r"^\s*o\s+([^\s#]+)", safe_str(scene_text), re.M)
    return "objects=%s vertices=%d faces=%d" % (", ".join(names[-12:]) if names else "(none)", count_vertices(scene_text), count_faces(scene_text))


def part_list(plan):
    try:
        return plan.get("parts", [])
    except Exception:
        return []


def build_part_prompt(plan, part, current_scene, original_request=""):
    action, target = part_action(part, current_scene)
    return "\n".join([
        "Original user request: " + (safe_str(original_request).strip() or "Generate the requested part"),
        "",
        "Requested part spec:",
        json.dumps(part, indent=2),
        "",
        "Overall part plan:",
        json.dumps(plan, indent=2),
        "",
        "Current scene summary:",
        summarize_scene(current_scene) or "(empty scene)",
        "",
        "Execution action:",
        action + ((" target=" + target) if target else ""),
        "",
        "If the action is replace, return one complete OBJ block for the target object. Keep the target object name stable.",
        "",
        "Grasshopper control policy:",
        "Include #@params: and #@controls: metadata for 2-5 meaningful part controls by default.",
        "Use canonical control syntax:",
        "#@controls:",
        "#@ - slider key=scale label=Scale min=0.5 max=2.0 step=0.05",
        "Every control key must be referenced by executable #@post syntax. Prefer transform scale/position with pivot, array count/offset, deform position, smooth iterations/strength, simplify ratio, or center_origin.",
        "Do not emit unsupported #@post attributes such as target=, origin=, translate=, rotate_y=, axis= for array spacing, or mode=.",
        "",
        "Generate only the requested part now.",
    ])


def request_mentions_controls(text):
    text = safe_str(text).lower()
    return any(word in text for word in [
        "control",
        "controls",
        "slider",
        "sliders",
        "parametric",
        "parameter",
        "parameters",
        "adjustable",
        "editable",
    ])


def has_controls_metadata(text):
    return re.search(r"^\s*#@controls\s*:", safe_str(text), re.M) is not None


def split_top_level_spaces(text):
    out = []
    buf = []
    depth = 0
    quote = None
    for ch in text or "":
        if quote:
            buf.append(ch)
            if ch == quote:
                quote = None
            continue
        if ch in ("'", '"'):
            quote = ch
            buf.append(ch)
            continue
        if ch in "[({":
            depth += 1
        elif ch in "])}":
            depth = max(0, depth - 1)
        if ch.isspace() and depth == 0:
            token = "".join(buf).strip()
            if token:
                out.append(token)
            buf = []
            continue
        buf.append(ch)
    token = "".join(buf).strip()
    if token:
        out.append(token)
    return out


def parse_post_line(text):
    parts = split_top_level_spaces(text)
    if not parts:
        return "", {}
    args = {}
    for token in parts[1:]:
        if "=" not in token:
            continue
        k, v = token.split("=", 1)
        k = k.strip().lower()
        if k:
            args[k] = v.strip()
    return parts[0].strip().lower(), args


def validate_post_line(text, object_name):
    cmd, args = parse_post_line(text)
    if not cmd:
        return []
    label = object_name or "object"
    issues = []
    if cmd not in SUPPORTED_POST_OPS:
        issues.append("%s: unsupported #@post operation '%s'" % (label, cmd))
        return issues
    allowed_attrs = SUPPORTED_POST_ATTRS.get(cmd, set())
    for key, value in args.items():
        if key not in allowed_attrs:
            issues.append("%s: unsupported #@post %s attribute '%s'" % (label, cmd, key))
        if re.search(r"\$\{[^}]+\}", value) or re.search(r"(?<!\[)\{[A-Za-z_][A-Za-z0-9_]*\}", value):
            issues.append("%s: #@post %s uses template placeholder syntax in %s=%s; use bare parameter names instead" % (label, cmd, key, value))
    if cmd == "smooth" and "level" in args and "iterations" not in args:
        issues.append("%s: smooth uses level=, but the executor expects smooth iterations=n strength=0.5" % label)
    if cmd == "tag" and "name" in args and "value" not in args:
        issues.append("%s: tag uses name=, but the executor contract expects tag value=..." % label)
    if cmd == "deform" and not ("position" in args or "expr" in args or "xyz" in args):
        issues.append("%s: deform expects position=[x,y,z]" % label)
    if cmd == "snap_to_ground" and ("surface" in args or "anchor" in args):
        issues.append("%s: snap_to_ground only supports axis=x|y|z; contact-to-surface placement is not supported in #@post" % label)
    return issues


def post_op_issues(obj_text):
    issues = []
    block = None
    object_name = "object"
    for raw in safe_str(obj_text).splitlines():
        line = raw.strip()
        if re.match(r"^\s*o\s+", raw):
            object_name = raw.strip().split(None, 1)[1].strip()
            block = None
            continue
        if not line.startswith("#@"):
            continue
        body = line[2:].strip()
        if body == "post:":
            block = "post"
            continue
        if body.startswith("post "):
            issues.extend(validate_post_line(body[len("post "):].strip(), object_name))
            block = None
            continue
        if body.endswith(":") and not body.startswith("-"):
            block = None
            continue
        if block == "post" and body.startswith("-"):
            issues.extend(validate_post_line(body[1:].strip(), object_name))
            continue
        if ":" in body and not body.startswith("-"):
            block = None
    return issues


def build_post_repair_prompt(part_text, issues):
    return "\n".join([
        "The previous raw OBJ part has invalid #@post syntax.",
        "Repair the #@post lines and return the full corrected OBJ part only.",
        "",
        "Validation issues:",
        "\n".join(["- " + issue for issue in issues]),
        "",
        "OBJ part to repair:",
        safe_str(part_text),
    ])


def repair_post_ops_if_needed(provider_name, api_key, model_name, part_text, base_url, max_out):
    issues = post_op_issues(part_text)
    if not issues:
        return part_text, []
    raw_repair = call_provider(
        provider_name,
        api_key,
        model_name,
        POST_REPAIR_PROMPT,
        build_post_repair_prompt(part_text, issues),
        base_url,
        max_out,
    )
    repaired = extract_text(provider_name, raw_repair)
    repaired = strip_code_fence(repaired)
    remaining = post_op_issues(repaired)
    if remaining:
        raise Exception("Generated part still has invalid #@post syntax after repair: " + "; ".join(remaining[:4]))
    return repaired, issues


def repair_controls_if_needed(provider_name, api_key, model_name, part_text, part, original_request, base_url, max_out):
    if has_controls_metadata(part_text):
        return part_text, False
    prompt = "\n".join([
        "Original user request:",
        safe_str(original_request) or "Generate the requested part",
        "",
        "Part plan:",
        json.dumps(part),
        "",
        "OBJ part to repair:",
        safe_str(part_text),
    ])
    raw_repair = call_provider(
        provider_name,
        api_key,
        model_name,
        CONTROL_REPAIR_PROMPT,
        prompt,
        base_url,
        max_out,
    )
    repaired = strip_code_fence(extract_text(provider_name, raw_repair))
    if not has_controls_metadata(repaired):
        raise Exception("Generated part still has no #@controls metadata after repair")
    return repaired, True


def visible_part_validation_issues(part_text):
    issues = []
    try:
        _, obj_text = split_part_text(part_text)
    except Exception as e:
        return [str(e)]
    blocks = split_scene_blocks(obj_text)[1]
    if not blocks:
        issues.append("No OBJ objects found")
    for name, block in blocks:
        vertices = count_vertices(block)
        faces = count_faces(block)
        if not has_controls_metadata(block):
            issues.append("Object '%s' is missing required #@controls metadata" % name)
        if vertices > 0 and faces == 0:
            issues.append("Object '%s' defines %d vertices but no faces, so it will not render" % (name, vertices))
        for line_no, line in enumerate(block.splitlines(), 1):
            if not re.match(r"^\s*f\s+", line):
                continue
            refs = face_refs(line)
            if len(refs) < 3:
                issues.append("Object '%s' has a face with fewer than 3 vertices near local line %d" % (name, line_no))
    issues.extend(post_op_issues(obj_text))
    return issues


def build_append_repair_hint(raw_part, append_error):
    return "\n".join([
        "Your previous OBJ part was invalid and could not be appended.",
        "Append error: " + safe_str(append_error),
        "Return the same requested part again as valid OBJ/Live OBJ only.",
        "The response must contain at least one OBJ object line like `o main_body` before any mesh vertices.",
        "Use local face indices starting at 1 for this returned part.",
        "Every visible raw mesh object/group with vertices must include faces.",
        "For #@post material, use only name=material_id. Do not include object=, target=, id=, color=, roughness, or metalness on the material op.",
        "Do not return the plan JSON, scene JSON, Markdown, or explanations.",
        "Previous invalid output:",
        safe_str(raw_part)[-12000:],
    ])


def build_validation_repair_hint(raw_part, issues):
    return "\n".join([
        "Your previous OBJ part appended but failed validation.",
        "Validation errors: " + "; ".join(issues[:12]),
        "Return the same requested part again as valid OBJ/Live OBJ only.",
        "Use a unique object name, include vertices, and ensure all visible raw mesh objects include faces.",
        "Every raw mesh object/group with vertices must include faces. Vertices without f lines are invisible and are not acceptable.",
        "If you model a body shell, connect section rings with side faces and cap the ends.",
        "For #@post material, use only name=material_id. Do not include object=, target=, id=, color=, roughness, or metalness on the material op.",
        "Use only supported #@post attributes. If a visual behavior needs unsupported attributes, bake it into real v/f geometry.",
        "Previous invalid output:",
        safe_str(raw_part)[-12000:],
    ])


def append_or_replace_part(current_scene, part_text, part):
    action, target = part_action(part, current_scene)
    if action == "replace":
        next_scene, normalized = replace_part(current_scene, part_text, target)
    else:
        next_scene, normalized = append_part(current_scene, part_text)
    return action, next_scene, normalized


def request_part_text(provider_name, api_key, model_name, plan, part, current_scene, original_request, base_url, max_out, repair_hint=""):
    user_prompt = build_part_prompt(plan, part, current_scene, original_request)
    if repair_hint:
        user_prompt = user_prompt + "\n\nRepair instruction for this part:\n" + repair_hint
    raw_part = call_provider(
        provider_name,
        api_key,
        model_name,
        PART_SYSTEM_PROMPT,
        user_prompt,
        base_url,
        max_out,
    )
    part_text = normalize_generated_part_metadata(extract_text(provider_name, raw_part))
    return raw_part, part_text


def prepare_part_text(provider_name, api_key, model_name, part_text, part, original_request, base_url, max_out):
    part_text = normalize_generated_part_metadata(part_text)
    part_text, _ = repair_controls_if_needed(
        provider_name,
        api_key,
        model_name,
        part_text,
        part,
        original_request,
        base_url,
        max_out,
    )
    part_text, _ = repair_post_ops_if_needed(
        provider_name,
        api_key,
        model_name,
        part_text,
        base_url,
        max_out,
    )
    return normalize_generated_part_metadata(part_text)


def generate_part_with_web_retries(provider_name, api_key, model_name, plan, part, current_scene, original_request, base_url, max_out):
    raw_attempts = []

    raw_part, part_text = request_part_text(
        provider_name, api_key, model_name, plan, part, current_scene, original_request, base_url, max_out
    )
    raw_attempts.append(extract_text(provider_name, raw_part))
    part_text = prepare_part_text(provider_name, api_key, model_name, part_text, part, original_request, base_url, max_out)

    try:
        action, next_scene, normalized = append_or_replace_part(current_scene, part_text, part)
    except Exception as first_error:
        raw_part, part_text = request_part_text(
            provider_name,
            api_key,
            model_name,
            plan,
            part,
            current_scene,
            original_request,
            base_url,
            max_out,
            build_append_repair_hint(part_text, first_error),
        )
        raw_attempts.append(extract_text(provider_name, raw_part))
        part_text = prepare_part_text(provider_name, api_key, model_name, part_text, part, original_request, base_url, max_out)
        action, next_scene, normalized = append_or_replace_part(current_scene, part_text, part)

    issues = visible_part_validation_issues(part_text)
    if issues:
        raw_part, part_text = request_part_text(
            provider_name,
            api_key,
            model_name,
            plan,
            part,
            current_scene,
            original_request,
            base_url,
            max_out,
            build_validation_repair_hint(part_text, issues),
        )
        raw_attempts.append(extract_text(provider_name, raw_part))
        part_text = prepare_part_text(provider_name, api_key, model_name, part_text, part, original_request, base_url, max_out)
        try:
            action, next_scene, normalized = append_or_replace_part(current_scene, part_text, part)
        except Exception as append_error:
            raw_part, part_text = request_part_text(
                provider_name,
                api_key,
                model_name,
                plan,
                part,
                current_scene,
                original_request,
                base_url,
                max_out,
                build_append_repair_hint(part_text, append_error),
            )
            raw_attempts.append(extract_text(provider_name, raw_part))
            part_text = prepare_part_text(provider_name, api_key, model_name, part_text, part, original_request, base_url, max_out)
            action, next_scene, normalized = append_or_replace_part(current_scene, part_text, part)
        issues = visible_part_validation_issues(part_text)
    if issues:
        raise Exception("Generated part failed validation after repair: " + "; ".join(issues[:6]))

    return action, next_scene, normalized, "\n\n# --- repair attempt ---\n\n".join([safe_str(a) for a in raw_attempts])


current_obj = safe_str(get_mem("current_obj", ""))
plan_json = safe_str(get_mem("plan_json", ""))
part_index = int(get_mem("part_index", 0) or 0)
status = "ready"
error = ""
debug = ""
active_part = ""

reset_pressed = button_pressed("reset")
plan_pressed = button_pressed("plan_run")
next_pressed = button_pressed("next_run")

if reset_pressed:
    clear_mem()
    current_obj = ""
    plan_json = ""
    part_index = 0
    status = "reset"

provider_name = safe_str(input_value("provider", "openai"), "openai").strip().lower()
api_key = safe_str(input_value("api_key", "")).strip()
model_name = safe_str(input_value("model", "")).strip()
scene_prompt = safe_str(input_value("prompt", "")).strip()
stored_scene_prompt = safe_str(get_mem("scene_prompt", scene_prompt)).strip() or scene_prompt
base_url = safe_str(input_value("base_url", "")).strip()
max_out = parse_max_tokens(input_value("max_tokens", None))
auto = bool_input("auto_run", False)
auto_delay = input_value("auto_delay_ms", 250)
try:
    auto_delay = max(50, int(auto_delay))
except Exception:
    auto_delay = 250

try:
    if plan_pressed:
        if not api_key:
            raise Exception("Missing api_key")
        if not scene_prompt:
            raise Exception("Missing prompt")
        status = "planning..."
        set_message(status)
        editing_existing = has_scene_objects(current_obj)
        if editing_existing:
            user = "\n".join([
                "Generation mode: tools-off raw-first OBJ edit.",
                "The current OBJ below is the source of truth.",
                "Plan ONLY raw mesh edit steps. Each part method must be \"llm_mesh\".",
                "For changes to an existing object, set action=\"replace\" and target to the existing o object name.",
                "For newly requested objects, set action=\"append\".",
                "Each replacement part prompt must ask for one complete replacement OBJ block with the same target object name.",
                "Preserve unrelated objects by not planning steps for them.",
                "Every replacement/addition prompt must explicitly require #@params: and #@controls: metadata for 2-5 practical Grasshopper controls. Controls are metadata, not visible scene objects.",
                "",
                "User edit request:",
                scene_prompt,
                "",
                "Current OBJ source:",
                safe_str(current_obj)[-12000:],
                "",
                "Create the iterative edit plan now.",
            ])
        else:
            user = "\n".join([
                "Generation mode: tools-off raw-first OBJ.",
                "Plan ONLY raw mesh parts. Each part method must be \"llm_mesh\".",
                "Every part prompt must explicitly require #@params: and #@controls: metadata for 2-5 practical Grasshopper controls. Controls are metadata, not visible scene objects.",
                "",
                "Plan this raw OBJ scene for iterative generation:",
                scene_prompt,
            ])
        raw = call_provider(provider_name, api_key, model_name, PLANNER_PROMPT, user, base_url, max_out)
        text = extract_text(provider_name, raw)
        plan = parse_json_object(text)
        plan_json = json.dumps(plan, indent=2)
        if not editing_existing:
            current_obj = DEFAULT_HEADER
            for mat in plan.get("materials", []):
                mid = mat.get("id")
                if not mid:
                    continue
                current_obj += "#@material_preset: %s color=%s roughness=%s metalness=%s\n" % (
                    mid,
                    mat.get("color", "#888888"),
                    mat.get("roughness", 0.7),
                    mat.get("metalness", 0.0),
                )
        set_mem("plan_json", plan_json)
        set_mem("current_obj", current_obj)
        set_mem("part_index", 0)
        set_mem("last_raw", raw)
        set_mem("scene_prompt", scene_prompt)
        stored_scene_prompt = scene_prompt
        part_index = 0
        status = ("planned edit " if editing_existing else "planned ") + "%d parts" % len(part_list(plan))

    should_generate_next = next_pressed or auto
    if should_generate_next:
        if not api_key:
            raise Exception("Missing api_key")
        if not plan_json:
            raise Exception("No plan yet. Press plan_run first.")
        plan = json.loads(plan_json)
        all_parts = part_list(plan)
        if part_index >= len(all_parts):
            status = "complete: %d/%d parts" % (part_index, len(all_parts))
        else:
            part = all_parts[part_index]
            active_part = "%s: %s" % (part.get("id", "part"), part.get("role", ""))
            status = "generating part %d/%d: %s" % (part_index + 1, len(all_parts), part.get("id", "part"))
            set_message(status)
            action, current_obj, normalized, raw_attempts = generate_part_with_web_retries(
                provider_name,
                api_key,
                model_name,
                plan,
                part,
                current_obj,
                stored_scene_prompt,
                base_url,
                max_out,
            )
            part_index += 1
            set_mem("current_obj", current_obj)
            set_mem("part_index", part_index)
            set_mem("last_raw", raw_attempts)
            set_mem("last_part", normalized)
            status = "%s part %d/%d: %s" % ("replaced" if action == "replace" else "appended", part_index, len(all_parts), part.get("id", "part"))
            if auto and part_index < len(all_parts):
                schedule_next(auto_delay)
except Exception as e:
    error = str(e)
    status = "error: " + error[:160]

try:
    plan = json.loads(plan_json) if plan_json else {"parts": []}
    plist = part_list(plan)
    parts = ["%02d %s - %s" % (i + 1, p.get("id", "part"), p.get("role", "")) for i, p in enumerate(plist)]
    if part_index < len(plist):
        p = plist[part_index]
        active_part = "%s: %s" % (p.get("id", "part"), p.get("role", ""))
    progress = "%d/%d" % (part_index, len(plist))
except Exception:
    parts = []
    progress = "0/0"

debug = "scene %s\nlast raw starts: %r" % (summarize_scene(current_obj), safe_str(get_mem("last_raw", ""))[:500])
set_message(status)
# ---------- end builder_script ----------
panel = Panel(builder_script.plan_json)
# DECOMPOSED BUILDER NODE
# 
# plan_run:
# Creates a part plan from the prompt.
# 
# next_run:
# Generates one part and appends it to the current OBJ.
# 
# auto_run:
# Keeps generating one part per solution until complete.
# 
# reset:
# Clears the stored plan and OBJ scene.
# 
# status / error / debug:
# Use these first when something seems stuck.
# RENDERER NODE
# 
# live_obj:
# OBJ / Live OBJ text from the builder.
# 
# values:
# Automatic sliders, toggles, and value lists connect here.
# 
# refresh_controls:
# Press once after new #@controls appear.
# 
# clear_controls:
# Removes generated controls.
# 
# The renderer reads #@up: y and displays geometry correctly in Rhino Z-up.
panel_2 = Panel(builder_script.current_obj)
panel_3 = Panel(builder_script.status)
renderer_script = GhPythonScript(live_obj=panel_2, refresh_controls=Button(), clear_controls=Button())  # -> out, meshes, controls, executed_obj, warnings; inputs values: list, refresh_controls: Boolean, clear_controls: Boolean
# ---------- renderer_script: Python ----------
# Spellshape Grasshopper - Live OBJ / Raw OBJ Renderer
# Release date: 2026-05-17
# License: MIT
# Source: https://github.com/StepanKukharskiy/live-obj
#
# Network behavior:
# - No network calls.
# - No telemetry.
# - Reads OBJ/Live OBJ text locally and creates Rhino preview meshes.
#
# Inputs to create:
#   live_obj          str
#   values            list access, item access also works if one value
#   refresh_controls  bool
#   clear_controls    bool
#   controls_below_px int optional, default 170
#
# Outputs to create:
#   meshes
#   controls
#   executed_obj
#   warnings
#   status
#
# Supported:
#   OBJ cache/raw v/f/o mesh parsing
#   #@up: y conversion into Rhino Z-up coordinates
#   #@params
#   #@controls: slider, seed, toggle, choice/value_list
#   #@post:
#     transform position=[x,y,z] rotation=[rx,ry,rz] scale=[sx,sy,sz]
#       optional: pivot=[x,y,z] for scale/rotation pivot in source coordinates
#     mirror axis=x|y|z
#     array count=n offset=[x,y,z] centered=true|false scale=[sx,sy,sz] position=[x,y,z] pivot=[x,y,z]
#       expressions may use i, index, step, count, t, params, sin(), cos(), sqrt(), pi, tau
#     deform position=[x,y,z]
#       expressions may use x, y, z plus normalized u, v, w vertex coordinates
#     symmetrize axis=x|y|z side=positive|negative
#     subdivide level=n
#     smooth iterations=n strength=0.5
#     simplify ratio=0.5
#     snap_to_ground axis=x|y|z
#     center_origin axes=xz|xy|yz|xyz

import ast
import math
import re
import System
import scriptcontext as sc
import Rhino.Geometry as rg
import Grasshopper
import Grasshopper.Kernel as ghk
import Grasshopper.Kernel.Special as ghks


GENERATED_PREFIX = "spellshape:"
EXPR_FUNCTIONS = {
    "abs": abs,
    "min": min,
    "max": max,
    "sin": math.sin,
    "cos": math.cos,
    "tan": math.tan,
    "sqrt": math.sqrt,
}
EXPR_CONSTANTS = {
    "pi": math.pi,
    "tau": math.pi * 2.0,
}
CONTROL_KINDS = set([
    "slider",
    "stepper",
    "toggle",
    "bool",
    "boolean",
    "choice",
    "value_list",
    "select",
    "dropdown",
    "enum",
    "multi-toggle",
    "multi_toggle",
])


class ControlSpec(object):
    def __init__(self, object_name, kind, key, label, min_v=None, max_v=None, step=None, options=None, value=None):
        self.object_name = object_name or "unnamed"
        self.kind = (kind or "slider").lower()
        self.key = key or ""
        self.label = (label or key or "").replace("_", " ")
        self.min = min_v
        self.max = max_v
        self.step = step
        self.options = options or []
        self.value = value

    @property
    def full_key(self):
        return "%s.%s" % (self.object_name, self.key)

    @property
    def nickname(self):
        return GENERATED_PREFIX + self.full_key

    def display(self):
        return "%s [%s] value=%s min=%s max=%s step=%s" % (
            self.full_key,
            self.kind,
            self.value,
            self.min,
            self.max,
            self.step,
        )


class PostOp(object):
    def __init__(self, cmd, args):
        self.cmd = (cmd or "").lower()
        self.args = args or {}


class Obj(object):
    def __init__(self, name="unnamed", first_vertex_index=1):
        self.name = name
        self.first_vertex_index = first_vertex_index
        self.vertices = []
        self.faces = []
        self.params = {}
        self.controls = []
        self.post_ops = []


class Scene(object):
    def __init__(self):
        self.objects = []
        self.controls = []
        self.params = {}
        self.up = "z"


def split_lines(text):
    return (text or "").replace("\r\n", "\n").replace("\r", "\n").split("\n")


def split_top_level(text, separator=","):
    out = []
    buf = []
    depth = 0
    quote = None
    for ch in text or "":
        if quote:
            buf.append(ch)
            if ch == quote:
                quote = None
            continue
        if ch in ("'", '"'):
            quote = ch
            buf.append(ch)
            continue
        if ch in "[({":
            depth += 1
        elif ch in "])}":
            depth = max(0, depth - 1)
        if ch == separator and depth == 0:
            token = "".join(buf).strip()
            if token:
                out.append(token)
            buf = []
            continue
        buf.append(ch)
    token = "".join(buf).strip()
    if token:
        out.append(token)
    return out


def split_top_level_spaces(text):
    out = []
    buf = []
    depth = 0
    quote = None
    for ch in text or "":
        if quote:
            buf.append(ch)
            if ch == quote:
                quote = None
            continue
        if ch in ("'", '"'):
            quote = ch
            buf.append(ch)
            continue
        if ch in "[({":
            depth += 1
        elif ch in "])}":
            depth = max(0, depth - 1)
        if ch.isspace() and depth == 0:
            token = "".join(buf).strip()
            if token:
                out.append(token)
            buf = []
            continue
        buf.append(ch)
    token = "".join(buf).strip()
    if token:
        out.append(token)
    return out


def parse_comma_kvs(text):
    out = {}
    for part in split_top_level(text, ","):
        if "=" not in part:
            continue
        k, v = part.split("=", 1)
        k = k.strip()
        if k:
            out[k] = v.strip()
    return out


def parse_param_kvs(text):
    parts = split_top_level(text, ",")
    if len(parts) <= 1:
        parts = split_top_level_spaces(text)
    out = {}
    for part in parts:
        if "=" not in part:
            continue
        k, v = part.split("=", 1)
        k = k.strip()
        if k:
            out[k] = v.strip().strip("\"'")
    return out


def parse_space_kvs(text):
    out = {}
    for token in split_top_level_spaces(text):
        if "=" not in token:
            continue
        k, v = token.split("=", 1)
        k = k.strip()
        if k:
            out[k] = v.strip().strip("\"'")
    return out


def parse_control(object_name, line, params=None):
    parts = split_top_level_spaces(line)
    if not parts:
        return None
    first = parts[0].strip()
    args = parse_space_kvs(" ".join(parts[1:]))
    if "type" in args or "kind" in args:
        kind = (args.get("type") or args.get("kind") or "slider").strip().lower()
        key = args.get("key") or args.get("param") or args.get("name") or first
    elif len(parts) >= 2 and parts[1].strip().lower() in CONTROL_KINDS:
        kind = parts[1].strip().lower()
        key = args.get("key") or args.get("param") or args.get("name") or first
    elif "=" in first:
        kind = "slider"
        key = args.get("key") or args.get("param") or args.get("name") or first
    else:
        kind = first.lower()
        key = args.get("key") or args.get("param") or args.get("name")
    if not key:
        return None
    if kind == "enum":
        kind = "choice"
    elif kind in ("multi-toggle", "multi_toggle"):
        kind = "choice"
    elif kind == "stepper":
        kind = "slider"
    options_raw = args.get("options") or args.get("values") or ""
    options = [p.strip() for p in re.split(r"[|,]", options_raw) if p.strip()]
    value = args.get("value") or args.get("default") or args.get("current")
    if value is None and params is not None:
        value = params.get(key.strip())
    return ControlSpec(
        object_name,
        kind,
        key.strip(),
        (args.get("label") or key).strip(),
        args.get("min"),
        args.get("max"),
        args.get("step"),
        options,
        value,
    )


def parse_post(line):
    parts = split_top_level_spaces(line)
    if not parts:
        return PostOp("", {})
    return PostOp(parts[0], parse_space_kvs(" ".join(parts[1:])))


def parse_face_index(token):
    head = token.split("/")[0]
    try:
        return int(head)
    except Exception:
        return 0


def parse_live_obj(text, warn):
    scene = Scene()
    current = None
    block = None
    global_vertex = 0
    seen_object = False

    def flush():
        if current is None:
            return
        if not (current.vertices or current.faces or current.params or current.controls or current.post_ops):
            return
        scene.objects.append(current)
        scene.controls.extend(current.controls)

    for raw in split_lines(text):
        line = raw.strip()
        if not line:
            continue

        m = re.match(r"^o\s+(.+)$", line)
        if m:
            flush()
            current = Obj(m.group(1).strip(), global_vertex + 1)
            block = None
            seen_object = True
            continue

        if current is None and seen_object:
            current = Obj("unnamed", global_vertex + 1)

        if line.startswith("#@"):
            body = line[2:].strip()
            low = body.lower()
            if low.startswith("up:"):
                up = body.split(":", 1)[1].strip().lower()
                if up in ("x", "y", "z"):
                    scene.up = up
                continue
            if low == "controls:":
                block = "controls"
                continue
            if low.startswith("controls:"):
                item = body[len("controls:") :].strip()
                c = parse_control(current.name if current is not None else "scene", item, current.params if current is not None else scene.params)
                if c:
                    if current is None:
                        scene.controls.append(c)
                    else:
                        current.controls.append(c)
                block = "controls"
                continue
            if low == "post:":
                block = "post"
                continue
            if low.startswith("params:"):
                if current is None:
                    scene.params.update(parse_param_kvs(body[len("params:") :]))
                else:
                    current.params.update(parse_param_kvs(body[len("params:") :]))
                block = "params"
                continue
            if body.endswith(":") and not body.startswith("-"):
                block = None
                continue
            if body.startswith("- "):
                item = body[2:].strip()
                if block == "controls":
                    c = parse_control(current.name if current is not None else "scene", item, current.params if current is not None else scene.params)
                    if c:
                        if current is None:
                            scene.controls.append(c)
                        else:
                            current.controls.append(c)
                elif block == "post":
                    op = parse_post(item)
                    if op.cmd:
                        current.post_ops.append(op)
                elif block == "params":
                    if current is None:
                        scene.params.update(parse_param_kvs(item))
                    else:
                        current.params.update(parse_param_kvs(item))
                continue
            if low.startswith("post "):
                op = parse_post(body[len("post ") :])
                if op.cmd:
                    current.post_ops.append(op)
            continue

        if line.startswith("v "):
            if current is None:
                current = Obj("unnamed", global_vertex + 1)
            parts = line.split()
            if len(parts) >= 4:
                try:
                    current.vertices.append(rg.Point3d(float(parts[1]), float(parts[2]), float(parts[3])))
                    global_vertex += 1
                except Exception as e:
                    warn.append("bad vertex on %s: %s" % (current.name, e))
            continue

        if line.startswith("f "):
            if current is None:
                current = Obj("unnamed", global_vertex + 1)
            ids = [parse_face_index(t) for t in line.split()[1:]]
            ids = [i for i in ids if i > 0]
            if len(ids) >= 3:
                current.faces.append(ids)

    flush()
    return scene


def values_to_overrides(ctrls, vals):
    if vals is None:
        vals = []
    elif not isinstance(vals, (list, tuple)):
        vals = [vals]
    out = {}
    for i, c in enumerate(ctrls):
        if i >= len(vals):
            break
        if vals[i] is None:
            continue
        out[c.full_key] = str(vals[i])
    return out


def apply_overrides(scene, overrides):
    for c in scene.controls:
        if c.full_key in overrides:
            scene.params[c.key] = overrides[c.full_key]
    for obj in scene.objects:
        for c in obj.controls:
            if c.full_key in overrides:
                obj.params[c.key] = overrides[c.full_key]


def object_scope(scene, obj):
    scope = dict(scene.params)
    scope.update(obj.params)
    return scope


def _scope_number(name, scope):
    if name in EXPR_CONSTANTS:
        return EXPR_CONSTANTS[name]
    if name not in scope:
        raise ValueError("unknown expression name: %s" % name)
    value = eval_number_or_none(scope[name], scope)
    if value is None:
        raise ValueError("non-numeric expression name: %s" % name)
    return value


def _eval_expr_node(node, scope):
    if isinstance(node, ast.Expression):
        return _eval_expr_node(node.body, scope)
    if isinstance(node, ast.Num):
        return float(node.n)
    if hasattr(ast, "Constant") and isinstance(node, ast.Constant):
        if isinstance(node.value, (int, float)):
            return float(node.value)
        raise ValueError("unsupported expression constant")
    if isinstance(node, ast.Name):
        return _scope_number(node.id, scope)
    if isinstance(node, ast.UnaryOp):
        value = _eval_expr_node(node.operand, scope)
        if isinstance(node.op, ast.USub):
            return -value
        if isinstance(node.op, ast.UAdd):
            return value
        raise ValueError("unsupported unary expression")
    if isinstance(node, ast.BinOp):
        left = _eval_expr_node(node.left, scope)
        right = _eval_expr_node(node.right, scope)
        if isinstance(node.op, ast.Add):
            return left + right
        if isinstance(node.op, ast.Sub):
            return left - right
        if isinstance(node.op, ast.Mult):
            return left * right
        if isinstance(node.op, ast.Div):
            return left / right
        if isinstance(node.op, ast.Pow):
            return left ** right
        raise ValueError("unsupported binary expression")
    if isinstance(node, ast.Call) and isinstance(node.func, ast.Name):
        fn = EXPR_FUNCTIONS.get(node.func.id)
        if fn is None:
            raise ValueError("unsupported expression function")
        return float(fn(*[_eval_expr_node(arg, scope) for arg in node.args]))
    raise ValueError("unsupported expression")


def eval_number_or_none(raw, scope):
    if raw is None:
        return None
    text = str(raw).strip()
    if text in scope:
        return eval_number_or_none(scope[text], scope)
    if re.search(r"\$\{[^}]+\}", text) or re.search(r"(?<!\[)\{[A-Za-z_][A-Za-z0-9_]*\}", text):
        return None
    try:
        return float(text)
    except Exception:
        pass
    try:
        return float(_eval_expr_node(ast.parse(text, mode="eval"), scope))
    except Exception:
        return None


def eval_number(raw, scope):
    value = eval_number_or_none(raw, scope)
    return 0.0 if value is None else value


def eval_bool(raw, default=False):
    if raw is None:
        return default
    text = str(raw).strip().lower()
    if text in ("1", "true", "yes", "on", "center", "centered"):
        return True
    if text in ("0", "false", "no", "off"):
        return False
    return default


def control_default_number(ctrl, fallback):
    raw = ctrl.value
    if raw in (None, ""):
        raw = fallback
    try:
        return float(raw)
    except Exception:
        try:
            return float(fallback)
        except Exception:
            return 0.0


def parse_vec3(raw, scope, default):
    if raw is None:
        return rg.Vector3d(*default)
    text = str(raw).strip()
    if text in scope:
        text = str(scope[text]).strip()
    if text.startswith("[") and text.endswith("]"):
        text = text[1:-1]
    parts = split_top_level(text, ",")
    if len(parts) < 3:
        return rg.Vector3d(*default)
    values = [eval_number_or_none(parts[0], scope), eval_number_or_none(parts[1], scope), eval_number_or_none(parts[2], scope)]
    if any(v is None for v in values):
        return rg.Vector3d(*default)
    return rg.Vector3d(values[0], values[1], values[2])


def source_to_rhino_transform(scene):
    # Rhino is Z-up. Web/raw OBJ files are often Y-up. Convert Y-up source
    # coordinates (x, y, z) to Rhino coordinates (x, -z, y), which is a
    # right-handed +90 degree rotation around X.
    if scene.up == "y":
        return rg.Transform.Rotation(math.radians(90.0), rg.Vector3d.XAxis, rg.Point3d.Origin)
    if scene.up == "x":
        # Defensive support only: X-up source to Rhino Z-up.
        return rg.Transform.Rotation(math.radians(-90.0), rg.Vector3d.YAxis, rg.Point3d.Origin)
    return rg.Transform.Identity


def rhino_to_source_transform(scene):
    if scene.up == "y":
        return rg.Transform.Rotation(math.radians(-90.0), rg.Vector3d.XAxis, rg.Point3d.Origin)
    if scene.up == "x":
        return rg.Transform.Rotation(math.radians(90.0), rg.Vector3d.YAxis, rg.Point3d.Origin)
    return rg.Transform.Identity


def source_to_rhino_axis(axis, scene):
    axis = (axis or "z").lower()
    if scene.up == "y":
        return {"x": "x", "y": "z", "z": "y"}.get(axis, axis)
    if scene.up == "x":
        return {"x": "z", "y": "y", "z": "x"}.get(axis, axis)
    return axis


def build_mesh(obj, warn, scene):
    if not obj.vertices or not obj.faces:
        return None
    source_to_rhino = source_to_rhino_transform(scene)
    mesh = rg.Mesh()
    for p in obj.vertices:
        p = rg.Point3d(p)
        p.Transform(source_to_rhino)
        mesh.Vertices.Add(p)
    for f in obj.faces:
        local = [i - obj.first_vertex_index for i in f]
        if any(i < 0 or i >= len(obj.vertices) for i in local):
            warn.append("skipped out-of-range face on %s" % obj.name)
            continue
        if len(local) == 3:
            mesh.Faces.AddFace(local[0], local[1], local[2])
        elif len(local) == 4:
            mesh.Faces.AddFace(local[0], local[1], local[2], local[3])
        else:
            for i in range(1, len(local) - 1):
                mesh.Faces.AddFace(local[0], local[i], local[i + 1])
    if mesh.Faces.Count == 0:
        return None
    mesh.Normals.ComputeNormals()
    mesh.Compact()
    return mesh


def get_arg(op, key, fallback):
    return op.args.get(key, fallback)


def sandwich_source_xform(source_xform, scene):
    if scene.up == "z":
        return source_xform
    return source_to_rhino_transform(scene) * source_xform * rhino_to_source_transform(scene)


def source_mirror_transform(axis):
    axis = (axis or "x").lower()
    plane = rg.Plane.WorldYZ if axis == "x" else rg.Plane.WorldZX if axis == "y" else rg.Plane.WorldXY
    return rg.Transform.Mirror(plane)


def face_indices(face):
    if face.IsTriangle:
        return [face.A, face.B, face.C]
    return [face.A, face.B, face.C, face.D]


def add_face(mesh, ids):
    if len(ids) == 3:
        mesh.Faces.AddFace(ids[0], ids[1], ids[2])
    elif len(ids) == 4:
        mesh.Faces.AddFace(ids[0], ids[1], ids[2], ids[3])


def face_centroid(mesh, face):
    ids = face_indices(face)
    if not ids:
        return rg.Point3d.Origin
    x = y = z = 0.0
    for idx in ids:
        p = mesh.Vertices[idx]
        x += p.X
        y += p.Y
        z += p.Z
    n = float(len(ids))
    return rg.Point3d(x / n, y / n, z / n)


def axis_value(point, axis):
    if axis == "x":
        return point.X
    if axis == "y":
        return point.Y
    return point.Z


def compact_mesh_faces(mesh, face_ids):
    out = rg.Mesh()
    used = {}
    for face_id in face_ids:
        face = mesh.Faces[face_id]
        remapped = []
        for idx in face_indices(face):
            if idx not in used:
                p = mesh.Vertices[idx]
                used[idx] = out.Vertices.Add(p.X, p.Y, p.Z)
            remapped.append(used[idx])
        add_face(out, remapped)
    out.Normals.ComputeNormals()
    out.Compact()
    return out


def duplicate_mirrored(mesh, axis, scene):
    copy = mesh.DuplicateMesh()
    copy.Transform(sandwich_source_xform(source_mirror_transform(axis), scene))
    return copy


def apply_symmetrize(mesh, op, scene, warn, obj_name):
    source_axis = get_arg(op, "axis", "x").lower()
    rhino_axis = source_to_rhino_axis(source_axis, scene)
    side = get_arg(op, "side", "positive").lower()
    sign = -1.0 if side in ("negative", "minus", "-") else 1.0
    try:
        tol = abs(eval_number(get_arg(op, "tolerance", "0.000001"), dict(scene.params)))
    except Exception:
        tol = 0.000001
    selected = []
    for i in range(mesh.Faces.Count):
        c = face_centroid(mesh, mesh.Faces[i])
        if sign * axis_value(c, rhino_axis) >= -tol:
            selected.append(i)
    if not selected:
        warn.append("symmetrize found no faces on requested side for %s; used mirror fallback" % obj_name)
        mesh.Append(duplicate_mirrored(mesh, source_axis, scene))
        return mesh
    half = compact_mesh_faces(mesh, selected)
    half.Append(duplicate_mirrored(half, source_axis, scene))
    return half


def apply_subdivide(mesh, op, scope):
    try:
        level = int(round(eval_number(get_arg(op, "level", "1"), scope)))
    except Exception:
        level = 1
    level = max(0, min(3, level))
    out = mesh.DuplicateMesh()
    for _ in range(level):
        next_mesh = rg.Mesh()
        for v in out.Vertices:
            next_mesh.Vertices.Add(v.X, v.Y, v.Z)
        for face in out.Faces:
            ids = face_indices(face)
            pts = [out.Vertices[i] for i in ids]
            x = sum(p.X for p in pts) / float(len(pts))
            y = sum(p.Y for p in pts) / float(len(pts))
            z = sum(p.Z for p in pts) / float(len(pts))
            center_idx = next_mesh.Vertices.Add(x, y, z)
            for i, a in enumerate(ids):
                b = ids[(i + 1) % len(ids)]
                next_mesh.Faces.AddFace(a, b, center_idx)
        next_mesh.Normals.ComputeNormals()
        next_mesh.Compact()
        out = next_mesh
    return out


def vertex_neighbors(mesh):
    neighbors = [set() for _ in range(mesh.Vertices.Count)]
    for face in mesh.Faces:
        ids = face_indices(face)
        for i, idx in enumerate(ids):
            prev_idx = ids[i - 1]
            next_idx = ids[(i + 1) % len(ids)]
            neighbors[idx].add(prev_idx)
            neighbors[idx].add(next_idx)
    return neighbors


def apply_smooth(mesh, op, scope):
    try:
        iterations = int(round(eval_number(get_arg(op, "iterations", get_arg(op, "level", "1")), scope)))
    except Exception:
        iterations = 1
    try:
        strength = eval_number(get_arg(op, "strength", "0.5"), scope)
    except Exception:
        strength = 0.5
    iterations = max(0, min(20, iterations))
    strength = max(0.0, min(1.0, strength))
    out = mesh.DuplicateMesh()
    for _ in range(iterations):
        neighbors = vertex_neighbors(out)
        points = []
        for i, v in enumerate(out.Vertices):
            ns = list(neighbors[i])
            if not ns:
                points.append(rg.Point3d(v.X, v.Y, v.Z))
                continue
            ax = sum(out.Vertices[n].X for n in ns) / float(len(ns))
            ay = sum(out.Vertices[n].Y for n in ns) / float(len(ns))
            az = sum(out.Vertices[n].Z for n in ns) / float(len(ns))
            points.append(rg.Point3d(
                v.X * (1.0 - strength) + ax * strength,
                v.Y * (1.0 - strength) + ay * strength,
                v.Z * (1.0 - strength) + az * strength,
            ))
        next_mesh = rg.Mesh()
        for p in points:
            next_mesh.Vertices.Add(p)
        for face in out.Faces:
            add_face(next_mesh, face_indices(face))
        next_mesh.Normals.ComputeNormals()
        next_mesh.Compact()
        out = next_mesh
    return out


def apply_simplify(mesh, op, scope):
    try:
        ratio = eval_number(get_arg(op, "ratio", "1"), scope)
    except Exception:
        ratio = 1.0
    ratio = max(0.05, min(1.0, ratio))
    if ratio >= 0.999 or mesh.Faces.Count == 0:
        return mesh
    target = max(1, int(math.ceil(mesh.Faces.Count * ratio)))
    step = max(1, int(round(float(mesh.Faces.Count) / float(target))))
    selected = [i for i in range(mesh.Faces.Count) if i % step == 0][:target]
    return compact_mesh_faces(mesh, selected)


def apply_deform(mesh, op, scope, scene):
    expr = get_arg(op, "position", get_arg(op, "xyz", "[x,y,z]"))
    out = mesh.DuplicateMesh()
    to_source = rhino_to_source_transform(scene)
    to_rhino = source_to_rhino_transform(scene)
    source_points = []
    for i in range(out.Vertices.Count):
        p = rg.Point3d(out.Vertices[i])
        p.Transform(to_source)
        source_points.append(p)
    if not source_points:
        return out

    min_x = min(p.X for p in source_points)
    min_y = min(p.Y for p in source_points)
    min_z = min(p.Z for p in source_points)
    max_x = max(p.X for p in source_points)
    max_y = max(p.Y for p in source_points)
    max_z = max(p.Z for p in source_points)
    span_x = max(max_x - min_x, 0.000001)
    span_y = max(max_y - min_y, 0.000001)
    span_z = max(max_z - min_z, 0.000001)
    count = max(1, len(source_points))

    for i, p in enumerate(source_points):
        local_scope = dict(scope)
        local_scope.update({
            "x": p.X,
            "y": p.Y,
            "z": p.Z,
            "u": (p.X - min_x) / span_x,
            "v": (p.Y - min_y) / span_y,
            "w": (p.Z - min_z) / span_z,
            "i": float(i),
            "index": float(i),
            "vertex_count": float(count),
            "count": float(count),
            "t": float(i) / float(max(1, count - 1)),
        })
        moved = parse_vec3(expr, local_scope, (p.X, p.Y, p.Z))
        rp = rg.Point3d(moved.X, moved.Y, moved.Z)
        rp.Transform(to_rhino)
        out.Vertices.SetVertex(i, rp.X, rp.Y, rp.Z)

    out.Normals.ComputeNormals()
    out.Compact()
    return out


def apply_post_ops(mesh, obj, warn, scene):
    scope = object_scope(scene, obj)
    for op in obj.post_ops:
        if op.cmd == "transform":
            pos = parse_vec3(get_arg(op, "position", "[0,0,0]"), scope, (0, 0, 0))
            rot = parse_vec3(get_arg(op, "rotation", "[0,0,0]"), scope, (0, 0, 0))
            scale = parse_vec3(get_arg(op, "scale", "[1,1,1]"), scope, (1, 1, 1))
            pivot = parse_vec3(get_arg(op, "pivot", "[0,0,0]"), scope, (0, 0, 0))
            xform = rg.Transform.Scale(rg.Plane.WorldXY, scale.X, scale.Y, scale.Z)
            xform = rg.Transform.Rotation(math.radians(rot.X), rg.Vector3d.XAxis, rg.Point3d.Origin) * xform
            xform = rg.Transform.Rotation(math.radians(rot.Y), rg.Vector3d.YAxis, rg.Point3d.Origin) * xform
            xform = rg.Transform.Rotation(math.radians(rot.Z), rg.Vector3d.ZAxis, rg.Point3d.Origin) * xform
            if pivot.Length > 0:
                xform = rg.Transform.Translation(pivot) * xform * rg.Transform.Translation(-pivot)
            xform = rg.Transform.Translation(pos) * xform
            mesh.Transform(sandwich_source_xform(xform, scene))
        elif op.cmd == "mirror":
            axis = get_arg(op, "axis", "x").lower()
            mesh.Append(duplicate_mirrored(mesh, axis, scene))
        elif op.cmd == "symmetrize":
            mesh = apply_symmetrize(mesh, op, scene, warn, obj.name)
        elif op.cmd == "array":
            count = max(1, int(round(eval_number(get_arg(op, "count", "1"), scope))))
            centered = eval_bool(get_arg(op, "centered", get_arg(op, "center", None)), False)
            base = mesh.DuplicateMesh()
            combined = rg.Mesh()
            for i in range(count):
                step = float(i)
                if centered and count > 1:
                    step = float(i) - 0.5 * float(count - 1)
                local_scope = dict(scope)
                local_scope.update({
                    "i": float(i),
                    "index": float(i),
                    "step": step,
                    "count": float(count),
                    "t": float(i) / float(max(1, count - 1)),
                })
                offset = parse_vec3(get_arg(op, "offset", "[1,0,0]"), local_scope, (1, 0, 0))
                scale = parse_vec3(get_arg(op, "scale", "[1,1,1]"), local_scope, (1, 1, 1))
                position = parse_vec3(get_arg(op, "position", "[0,0,0]"), local_scope, (0, 0, 0))
                pivot = parse_vec3(get_arg(op, "pivot", "[0,0,0]"), local_scope, (0, 0, 0))
                translation = offset * step + position
                xform = rg.Transform.Scale(rg.Plane.WorldXY, scale.X, scale.Y, scale.Z)
                if pivot.Length > 0:
                    xform = rg.Transform.Translation(pivot) * xform * rg.Transform.Translation(-pivot)
                xform = rg.Transform.Translation(translation) * xform
                copy = base.DuplicateMesh()
                copy.Transform(sandwich_source_xform(xform, scene))
                combined.Append(copy)
            mesh = combined
        elif op.cmd == "deform":
            mesh = apply_deform(mesh, op, scope, scene)
        elif op.cmd == "subdivide":
            mesh = apply_subdivide(mesh, op, scope)
        elif op.cmd == "smooth":
            if "level" in op.args and "iterations" not in op.args:
                warn.append("accepted smooth level= as iterations= on %s; generator should emit iterations=" % obj.name)
            mesh = apply_smooth(mesh, op, scope)
        elif op.cmd == "simplify":
            mesh = apply_simplify(mesh, op, scope)
        elif op.cmd == "snap_to_ground":
            axis = source_to_rhino_axis(get_arg(op, "axis", scene.up), scene)
            bb = mesh.GetBoundingBox(True)
            if axis == "x":
                move = rg.Vector3d(-bb.Min.X, 0, 0)
            elif axis == "y":
                move = rg.Vector3d(0, -bb.Min.Y, 0)
            else:
                move = rg.Vector3d(0, 0, -bb.Min.Z)
            mesh.Transform(rg.Transform.Translation(move))
        elif op.cmd == "center_origin":
            source_axes = get_arg(op, "axes", "xyz").lower()
            axes = "".join(sorted(set(source_to_rhino_axis(a, scene) for a in source_axes if a in "xyz")))
            bb = mesh.GetBoundingBox(True)
            c = bb.Center
            mesh.Transform(rg.Transform.Translation(
                -c.X if "x" in axes else 0,
                -c.Y if "y" in axes else 0,
                -c.Z if "z" in axes else 0,
            ))
        elif op.cmd in ("material", "tag"):
            pass
        else:
            warn.append("unsupported #@post op on %s: %s" % (obj.name, op.cmd))
    mesh.Normals.ComputeNormals()
    mesh.Compact()
    return mesh


def serialize_meshes(mesh_list):
    lines = []
    offset = 1
    for mi, mesh in enumerate(mesh_list):
        lines.append("o mesh_%d" % mi)
        for v in mesh.Vertices:
            lines.append("v %.8g %.8g %.8g" % (v.X, v.Y, v.Z))
        for f in mesh.Faces:
            if f.IsTriangle:
                lines.append("f %d %d %d" % (f.A + offset, f.B + offset, f.C + offset))
            else:
                lines.append("f %d %d %d %d" % (f.A + offset, f.B + offset, f.C + offset, f.D + offset))
        offset += mesh.Vertices.Count
    return "\n".join(lines)


def gh_doc():
    try:
        return ghenv.Component.OnPingDocument()
    except Exception:
        return None


def control_state_key(name):
    try:
        guid = str(ghenv.Component.InstanceGuid)
    except Exception:
        guid = "default"
    return "spellshape_renderer:%s:%s" % (guid, name)


def remove_generated_controls(doc=None):
    if doc is None:
        doc = gh_doc()
    if doc is None:
        return
    mine = []
    for obj in doc.Objects:
        if getattr(obj, "NickName", "").startswith(GENERATED_PREFIX):
            mine.append(obj)
    for obj in mine:
        doc.RemoveObject(obj, False)


def controls_need_refresh(ctrls):
    try:
        input_param = ghenv.Component.Params.Input[1]
    except Exception:
        return False
    sources = list(input_param.Sources)
    if len(sources) != len(ctrls):
        return True
    for source, ctrl in zip(sources, ctrls):
        if source.NickName != ctrl.nickname:
            return True
    return False


def create_control_object(ctrl):
    kind = ctrl.kind
    if kind in ("toggle", "bool", "boolean"):
        obj = ghks.GH_BooleanToggle()
        obj.Name = ctrl.label
        obj.NickName = ctrl.nickname
        obj.Value = eval_bool(ctrl.value, False)
        obj.CreateAttributes()
        return obj

    if kind in ("choice", "value_list", "select", "dropdown"):
        obj = ghks.GH_ValueList()
        obj.Name = ctrl.label
        obj.NickName = ctrl.nickname
        obj.ListItems.Clear()
        opts = ctrl.options or ["default"]
        for opt in opts:
            obj.ListItems.Add(ghks.GH_ValueListItem(opt, '"%s"' % opt))
        obj.CreateAttributes()
        return obj

    obj = ghks.GH_NumberSlider()
    obj.Name = ctrl.label
    obj.NickName = ctrl.nickname
    min_v = float(ctrl.min) if ctrl.min not in (None, "") else 0.0
    max_v = float(ctrl.max) if ctrl.max not in (None, "") else 1.0
    step_v = abs(float(ctrl.step)) if ctrl.step not in (None, "") else 0.01
    value_v = control_default_number(ctrl, min_v)
    value_v = max(min_v, min(max_v, value_v))
    obj.Slider.Minimum = System.Decimal(min_v)
    obj.Slider.Maximum = System.Decimal(max_v)
    obj.Slider.DecimalPlaces = 0 if step_v >= 1 else 1 if step_v >= 0.1 else 2 if step_v >= 0.01 else 3
    obj.SetSliderValue(System.Decimal(value_v))
    obj.CreateAttributes()
    return obj


def create_or_refresh_controls_now(ctrls, doc, below_px):
    if doc is None:
        return
    try:
        input_param = ghenv.Component.Params.Input[1]
    except Exception:
        return

    input_param.RemoveAllSources()
    remove_generated_controls(doc)

    pivot = ghenv.Component.Attributes.Pivot
    x = pivot.X - 220
    y = pivot.Y + below_px

    created = []
    for i, ctrl in enumerate(ctrls):
        obj = create_control_object(ctrl)
        obj.Attributes.Pivot = System.Drawing.PointF(x, y + i * 32)
        doc.AddObject(obj, False)
        created.append(obj)
        try:
            input_param.AddSource(obj)
        except Exception:
            pass

    ghenv.Component.Params.OnParametersChanged()


def create_or_refresh_controls(ctrls):
    doc = gh_doc()
    if doc is None:
        return
    pending_key = control_state_key("refresh_pending")
    if sc.sticky.get(pending_key, False):
        return
    try:
        below_px = int(controls_below_px)
    except Exception:
        below_px = 170
    below_px = max(80, min(600, below_px))
    ctrl_snapshot = list(ctrls)
    sc.sticky[pending_key] = True

    def callback(d):
        try:
            create_or_refresh_controls_now(ctrl_snapshot, d, below_px)
        finally:
            sc.sticky[pending_key] = False
        try:
            ghenv.Component.ExpireSolution(False)
        except Exception:
            pass

    doc.ScheduleSolution(1, callback)


def clear_generated_controls():
    doc = gh_doc()
    if doc is None:
        return
    pending_key = control_state_key("clear_pending")
    if sc.sticky.get(pending_key, False):
        return
    sc.sticky[pending_key] = True

    def callback(d):
        try:
            remove_generated_controls(d)
        finally:
            sc.sticky[pending_key] = False
        try:
            ghenv.Component.ExpireSolution(False)
        except Exception:
            pass

    doc.ScheduleSolution(1, callback)


# Main execution.
warnings = []
scene = parse_live_obj(live_obj or "", warnings)

if clear_controls:
    clear_generated_controls()

if scene.controls and (refresh_controls or controls_need_refresh(scene.controls)):
    create_or_refresh_controls(scene.controls)

overrides = values_to_overrides(scene.controls, values)
apply_overrides(scene, overrides)

meshes = []
for obj in scene.objects:
    mesh = build_mesh(obj, warnings, scene)
    if mesh is None:
        continue
    mesh = apply_post_ops(mesh, obj, warnings, scene)
    meshes.append(mesh)

controls = [c.display() for c in scene.controls]
executed_obj = serialize_meshes(meshes)
status = "objects=%d controls=%d meshes=%d warnings=%d up=%s input_chars=%d" % (
    len(scene.objects),
    len(scene.controls),
    len(meshes),
    len(warnings),
    scene.up,
    len(live_obj or ""),
)

if len(scene.objects) == 0 and (live_obj or "").strip():
    warnings.append("No OBJ objects parsed. Input starts with: %r" % ((live_obj or "").strip()[:240],))
elif len(meshes) == 0 and len(scene.objects) > 0:
    summary = []
    for obj in scene.objects[:8]:
        summary.append("%s: v=%d f=%d" % (obj.name, len(obj.vertices), len(obj.faces)))
    warnings.append("Parsed objects but no renderable meshes: " + "; ".join(summary))

try:
    ghenv.Component.Message = status
except Exception:
    pass
# ---------- end renderer_script ----------
panel_4 = Panel(renderer_script.out)
panel_5 = Panel(renderer_script.meshes)
panel_6 = Panel(renderer_script.executed_obj)
panel_7 = Panel(renderer_script.warnings)
panel_8 = Panel(renderer_script.controls)

# ----
# UPDATES
# 
# Check the Spellshape Grasshopper download page for the latest .gh file.
# The GHPython scripts include a release date at the top.
# If your local release date is older than the website release date, download the new GH file.
# PRIVACY
# 
# This GH file calls your chosen LLM provider directly from your Rhino machine.
# Spellshape does not proxy these LLM calls.
# The GHPython scripts do not send telemetry to Spellshape.
# API keys, prompts, and OBJ files stay between you and your selected provider.
button_2 = Button()
update_checker_script = GhPythonScript(check=button_2)  # -> out, info, update_available, latest_date, release_url, raw_json, error; inputs check: Boolean
# ---------- update_checker_script: Python ----------
# Spellshape Grasshopper - Update Checker
# Release date: 2026-05-17
# License: MIT
# Source: https://github.com/StepanKukharskiy/live-obj
#
# Network behavior:
# - Only runs when check=True.
# - Sends one GET request to the configured Spellshape release JSON URL.
# - Does not send telemetry from this script.
#
# Inputs to create:
#   check       bool  button: check for updates
#   site_url    str   optional, default https://live-obj-production.up.railway.app/
#   local_date  str   optional, default release date below
#   timeout_sec int   optional HTTP timeout, default 15
#
# Outputs to create:
#   info
#   update_available
#   latest_date
#   release_url
#   raw_json
#   error
#
# Wire info to a Panel.

import json
import System
import scriptcontext as sc
from System.IO import StreamReader
from System.Net import WebRequest, ServicePointManager, SecurityProtocolType


LOCAL_RELEASE_DATE = "2026-05-17"
DEFAULT_SITE_URL = "https://live-obj-production.up.railway.app/"
RELEASE_PATH = "grasshopper-release.json"


def safe_str(value, fallback=""):
    if value is None:
        return fallback
    return str(value)


def input_value(name, fallback=None):
    try:
        return globals().get(name, fallback)
    except Exception:
        return fallback


def set_message(text):
    try:
        ghenv.Component.Message = text
    except Exception:
        pass


def sticky_key(name):
    try:
        guid = str(ghenv.Component.InstanceGuid)
    except Exception:
        guid = "default"
    return "spellshape_update_check:%s:%s" % (guid, name)


def get_cached(name, fallback=None):
    return sc.sticky.get(sticky_key(name), fallback)


def set_cached(name, value):
    sc.sticky[sticky_key(name)] = value


def save_result():
    set_cached("info", info)
    set_cached("update_available", update_available)
    set_cached("latest_date", latest_date)
    set_cached("release_url", release_url)
    set_cached("raw_json", raw_json)
    set_cached("error", error)


def parse_timeout_ms(value):
    try:
        seconds = int(value)
    except Exception:
        seconds = 15
    seconds = max(5, min(60, seconds))
    return seconds * 1000


def release_endpoint(site):
    site = safe_str(site, DEFAULT_SITE_URL).strip() or DEFAULT_SITE_URL
    site = site.rstrip("/") + "/"
    return site + RELEASE_PATH


def fetch_text(url):
    try:
        ServicePointManager.SecurityProtocol = SecurityProtocolType.Tls12
    except Exception:
        pass
    req = WebRequest.Create(url)
    req.Method = "GET"
    timeout_ms = parse_timeout_ms(input_value("timeout_sec", None))
    try:
        req.Timeout = timeout_ms
        req.ReadWriteTimeout = timeout_ms
    except Exception:
        pass
    resp = req.GetResponse()
    reader = StreamReader(resp.GetResponseStream())
    try:
        return reader.ReadToEnd()
    finally:
        reader.Close()
        resp.Close()


def date_key(text):
    parts = safe_str(text).strip().split("-")
    if len(parts) != 3:
        return (0, 0, 0)
    try:
        return (int(parts[0]), int(parts[1]), int(parts[2]))
    except Exception:
        return (0, 0, 0)


release_url = release_endpoint(input_value("site_url", DEFAULT_SITE_URL))
info = safe_str(get_cached("info", "Press check to look for Spellshape Grasshopper updates."))
update_available = bool(get_cached("update_available", False))
latest_date = safe_str(get_cached("latest_date", ""))
raw_json = safe_str(get_cached("raw_json", ""))
error = safe_str(get_cached("error", ""))

local = safe_str(input_value("local_date", LOCAL_RELEASE_DATE), LOCAL_RELEASE_DATE).strip() or LOCAL_RELEASE_DATE

if bool(input_value("check", False)):
    try:
        set_message("checking...")
        raw_json = fetch_text(release_url)
        data = json.loads(raw_json)
        latest_date = safe_str(data.get("latest_date", "")).strip()
        message = safe_str(data.get("message", "")).strip()
        download_url = safe_str(data.get("download_url", DEFAULT_SITE_URL)).strip()
        update_available = date_key(latest_date) > date_key(local)
        if update_available:
            info = "\n".join([
                "Update available",
                "Local date: " + local,
                "Latest date: " + latest_date,
                message or "Download the latest Spellshape Grasshopper file.",
                "URL: " + download_url,
            ])
            set_message("update available")
        else:
            info = "\n".join([
                "Spellshape Grasshopper scripts are up to date.",
                "Local date: " + local,
                "Latest date: " + (latest_date or "unknown"),
            ])
            set_message("up to date")
        save_result()
    except Exception as e:
        error = str(e)
        info = "Update check failed: " + error
        set_message("check failed")
        save_result()
else:
    if latest_date:
        set_message("last checked")
    else:
        set_message("idle")
# ---------- end update_checker_script ----------
panel_9 = Panel(update_checker_script.error)
panel_10 = Panel(update_checker_script.info)
panel_11 = Panel(update_checker_script.latest_date)
panel_12 = Panel(update_checker_script.update_available)
